# Grasshopper definition TenrecSAMPLETest.gh (Grasshopper 1.0.7)
# plug-ins: Tenrec

# ---- group: TestGroup C
sph = Sphere(Base=PlaneXY(0, 0, 0), Radius=10)
bbox = BoundingBox(Content=sph, Plane=PlaneXY(0, 0, 0))  # -> Box, Box_2
volume = Volume(Geometry=bbox.Box)  # -> Volume, Centroid
equals = Equality(FirstNumber=volume.Volume, SecondNumber="500")  # -> Equality, Inequality
format = Format(Format="{0} to equal to {1}", Culture=127, Data0=volume.Volume, Data1="500")
assert = Assert(Assert=equals.Equality, Message=format)

# ---- group: TestGroup A
assert_a_1 = Assert(Assert=Toggle(False), Message="Sample error message")
assert_a_2 = Assert(Assert=True, Message="Sample warning message")

# ---- group: TestGroup B
circle = Circle({Plane=Plane(origin=(-3, 4, 0), x=(0.8087360843, -0.5881716977, 0), y=(0.5881716977, 0.8087360843, 0)), Radius=13.60147051})
rec = Rectangle(circle)
